# Grasshopper definition PillowBox.gh (Grasshopper 1.0.7)

number_slider = Slider(0.25, range=0..1)
a = Slider(129.38, range=0..360)
divide = Slider(10, range=5..20)
toggle = BooleanToggle(False)
rectangle = Rectangle(Plane=PlaneXY(0, 0, 0), XSize=Slider(20, range=10..20), YSize=Slider(12.64, range=10..20), Radius=0)  # -> Rectangle, Length
rad = Radians(Degrees=a)
cp = ControlPoints(Curve=rectangle.Rectangle)  # -> Points, Weights, Knots
input_curve = CSharpScript(P=cp.Points, N=divide)  # -> out, Points2d, Bezier2d, K_ori; inputs P: list of Point3d, N: Int32
# ---------- input_curve: C# ----------
List<Point3d> CP2d = new List<Point3d>();
List<Point3d> BP2d = new List<Point3d>();
List<double> K = new List<double>();
Vector3d Axis = new Vector3d(0,1,0);
Point3d p0 = P[0],  p3 = P[1];
double y = P[3].Y / 2;

Point3d p1 = p3 / 4.0 + 3.0 / 4.0 * p0; p1.Y += y;
Point3d p2 = p0 / 4.0 + 3.0 / 4.0 * p3; p2.Y += y;
CP2d.Add(new Point3d(P[0])); CP2d.Add(p1); CP2d.Add(p2); CP2d.Add(new Point3d(P[1]));

for(int n = 0; n < N; n++){
    double t = 1 - (double) n / (double) (N - 1);
    Point3d p = new Point3d(0, 0, 0);
    for(int i = 0; i < 4; i++)p += cmb(3, i) * Math.Pow(1.0 - t, 3 - i) * Math.Pow(t, i) * CP2d[i];
    BP2d.Add(p);
}

for(int i = 1; i < N - 1; i++){
    Vector3d e = new Vector3d(BP2d[i-1] - BP2d[i]); e.Unitize();
    Vector3d e2 = new Vector3d(BP2d[i+1] - BP2d[i]); e.Unitize();
    double k = 2 * Math.PI - Math.Abs(Vector3d.VectorAngle(e, Axis)) - Math.Abs(Vector3d.VectorAngle(e2, Axis));

    K.Add(k);
}

Points2d = CP2d; Bezier2d = BP2d; K_ori = K;
# ---------- input_curve: C# additional code ----------
  double fact(int n){
    if(n <= 1)return 1;
    return n * fact(n - 1);
  }
  double cmb(int n, int k){
    return fact(n) / fact(k);
  }
# ---------- end input_curve ----------
projection_on_3d_space = CSharpScript(P=input_curve.Points2d)  # -> out, Points3d, Points2d, Bezier3d, Bezier2d; inputs P: list of Point3d
# ---------- projection_on_3d_space: C# ----------
List<Point3d> CP3d = new List<Point3d>();
List<Point3d> CP2d = new List<Point3d>();

Point3d p0 = P[0],  p3 = P[1];
double y = P[3].Y / 2;

Point3d p1 = p3 / 4.0 + 3.0 / 4.0 * p0; p1.Y += y;
Point3d p2 = p0 / 4.0 + 3.0 / 4.0 * p3; p2.Y += y;
CP2d.Add(new Point3d(P[0])); CP2d.Add(p1); CP2d.Add(p2); CP2d.Add(new Point3d(P[1]));

p1.Z += 5; p2.Z += 5;
CP3d.Add(new Point3d(P[0])); CP3d.Add(p1); CP3d.Add(p2); CP3d.Add(new Point3d(P[1]));

List<Point3d> BP2d = new List<Point3d>();
List<Point3d> BP3d = new List<Point3d>();
for(int n = 0; n < N; n++){
    double t = 1 - (double) n / (double) (N - 1);
    Point3d p = new Point3d(0, 0, 0);
    for(int i = 0; i < 4; i++)p += cmb(3, i) * Math.Pow(1.0 - t, 3 - i) * Math.Pow(t, i) * CP3d[i];
    BP3d.Add(p);
}

for(int n = 0; n < N; n++){
    double t = 1 - (double) n / (double) (N - 1);
    Point3d p = new Point3d(0, 0, 0);
    for(int i = 0; i < 4; i++)p += cmb(3, i) * Math.Pow(1.0 - t, 3 - i) * Math.Pow(t, i) * CP2d[i];
    BP2d.Add(p);
}

Points2d = CP2d; Points3d = CP3d;
Bezier3d = BP3d; Bezier2d = BP2d;
# ---------- projection_on_3d_space: C# additional code ----------
  double fact(int n){
    if(n <= 1)return 1;
    return n * fact(n - 1);
  }
  double cmb(int n, int k){
    return fact(n) / fact(k);
  }
# ---------- end projection_on_3d_space ----------
pt = Point()
generate_rulings_directions = CSharpScript(Bezier3d=projection_on_3d_space.Bezier3d, Bezier2d=projection_on_3d_space.Bezier2d, a=rad)  # -> out, K, Beta, Theta, Normals, Rulings3d, Rulings2d, Tau, A; inputs Bezier3d: list of Point3d, Bezier2d: list of Point3d, a: Double
# ---------- generate_rulings_directions: C# ----------
List<double> _K = new List<double>(), _B = new List<double>(), _T = new List<double>(), _Tau = new List<double>(), _A = new List<double>();
List<Vector3d> _Normals = new List<Vector3d>(), _Rulings3d = new List<Vector3d>();
List<Vector3d> _Rulings2d = new List<Vector3d>();
Vector3d Axis = new Vector3d(0,1,0);
Vector3d befN = new Vector3d(), N = new Vector3d();
Vector3d Z = new Vector3d(0,0,-1);
double a2 = 0.0;

for(int i = 1; i < Bezier3d.Count - 1; i++){
    Vector3d e =  new Vector3d(Bezier3d[i-1] - Bezier3d[i]); e.Unitize();
    Vector3d e2 = new Vector3d(Bezier3d[i+1] - Bezier3d[i]); e2.Unitize();
    N = Vector3d.CrossProduct(e, e2); N.Unitize();
    if(i != 1){
        Vector3d SrfN = ProjectionVec(e, N);
        double tau = Math.Acos(Vector3d.Multiply(befN, SrfN));
        if(Vector3d.Multiply(e, Vector3d.CrossProduct(befN, SrfN)) < 0)tau = 2 * Math.PI - tau;
        a = a2 - tau;
        if(a < 0) a += 2 * Math.PI;
        _Tau.Add(tau);
    }
    double b = Vector3d.VectorAngle(e, e2);
    double k = 2 * Math.PI - Math.Abs(Vector3d.VectorAngle(e, Axis)) - Math.Abs(Vector3d.VectorAngle(e2, Axis));

    N.Rotate(a, e);
    double theta = Math.Atan2(Math.Cos(k) - Math.Cos(b), Math.Sin(b)* Math.Cos(a) - Math.Sin(k));
    if(theta < 0) theta += Math.PI;
    Vector3d r3d = new Vector3d(e); r3d.Rotate(theta, N);
    Vector3d r2d = new Vector3d(Bezier2d[i - 1] - Bezier2d[i]); r2d.Unitize(); r2d.Rotate(theta, Z);
    _Rulings2d.Add(r2d); _Rulings3d.Add(r3d);
    double sin_a = Math.Sin(a) * Math.Sin(theta)/Math.Sin(k - theta);
    double cos_a = (Math.Cos(theta) - Math.Cos(k - theta)*Math.Cos(b))/(Math.Sin(k - theta)*Math.Sin(b));
    a2 = Math.Atan(sin_a/cos_a);
    if(a2 < 0) a2 += 2 * Math.PI;
    befN = ProjectionVec(e2, Vector3d.CrossProduct(e, e2));  befN.Unitize();
    _K.Add(k); _B.Add(b); _Normals.Add(N); _A.Add(cos_a); _T.Add(theta);
}

K = _K; Beta = _B; Theta = _T; Rulings3d = _Rulings3d; Rulings2d = _Rulings2d; Normals = _Normals; Tau = _Tau; A = _A;
# ---------- generate_rulings_directions: C# additional code ----------
Vector3d ProjectionVec(Vector3d N, Vector3d v){
    N.Unitize();
    Vector3d V = new Vector3d(v - Vector3d.Multiply(Vector3d.Multiply(v,N), N));
    V.Unitize();
    return V;
}
# ---------- end generate_rulings_directions ----------
getcrosspoints = CSharpScript(
    Outline=cp.Points,
    Bezier2d=projection_on_3d_space.Bezier2d,
    Bezier3d=projection_on_3d_space.Bezier3d,
    Rulings2d=generate_rulings_directions.Rulings2d,
    Rulings3d=generate_rulings_directions.Rulings3d)  # -> out, Line2d, Line3d; inputs Outline: list of Point3d, Bezier2d: list of Point3d, Bezier3d: list of Point3d, Rulings2d: list of Vector3d, Rulings3d: list of Vector3d
# ---------- getcrosspoints: C# ----------
double len = 1000;
List<Line> L2d = new List<Line>();
List<Line> L3d = new List<Line>();
for(int i = 0; i < Rulings2d.Count; i++){
    Line la = new Line(Bezier2d[i+1], Rulings2d[i], len);
    for(int j = 0; j < Outline.Count - 1; j++){
        double a, b;
        Line lb = new Line(Outline[j], Outline[j+1]);
        if(Rhino.Geometry.Intersect.Intersection.LineLine(la, lb, out a, out b)){
            if(0 <= b && b <= 1 && 0 <= a && a <= 1){
                Point3d p2d = la.PointAt(a);
                L2d.Add(new Line(Bezier2d[i+1], p2d));
                Point3d p3d = p2d.DistanceTo(Bezier2d[i+1]) * Rulings3d[i] + Bezier3d[i+1];
                L3d.Add(new Line(Bezier3d[i+1], p3d));
            }
        }
    }
}
Line2d = L2d; Line3d = L3d;
# ---------- end getcrosspoints ----------
e_plane = CSharpScript(Line3d=getcrosspoints.Line3d)  # -> out, f; inputs Line3d: list of Line
# ---------- e_plane: C# ----------
double _f = 0.0;
foreach(Line l in Line3d){
    _f += Math.Abs(l.To.Z);
}
f = _f;
# ---------- end e_plane ----------
e_iso = CSharpScript(Bezier3d=projection_on_3d_space.Bezier3d)  # -> out, f; inputs Crv_ori: list of Point3d, Bezier3d: list of Point3d
# ---------- e_iso: C# ----------
double _f = 0.0;
for(int i = 0; i < Crv_ori.Count - 1; i++){
  _f += Math.Abs(Crv_ori[i].DistanceTo(Crv_ori[i+1]) - Bezier3d[i].DistanceTo(Bezier3d[i+1]));
}
f = _f;
# ---------- end e_iso ----------
e_ruling = CSharpScript(Line3d=getcrosspoints.Line2d)  # -> out, f; inputs Line3d: list of Line
# ---------- e_ruling: C# ----------
double _f = 0.0;
double a,b;
for(int i = 0; i < Line3d.Count; i++){
    for(int j = -1; j <= 1; j += 2){
        int i2 = i + j;
        if(i2 < 0 || i2 >= Line3d.Count)continue;
        if(Rhino.Geometry.Intersect.Intersection.LineLine(Line3d[i], Line3d[i2], out a, out b)){
            if(0 <= b && b <= 1 && 0 <= a && a <= 1)_f += 1.0/b;
        }
    }
}
f = _f;
# ---------- end e_ruling ----------
e_sim = CSharpScript(K_ori=input_curve.K_ori, K=generate_rulings_directions.K)  # -> out, f; inputs K_ori: list of Double, K: list of Double
# ---------- e_sim: C# ----------
double _f = 0.0;
for(int i = 0; i < K_ori.Count; i++)_f += Math.Abs(K_ori[i] - K[i]);
f = _f;
# ---------- end e_sim ----------
