# Grasshopper definition check.gh (Grasshopper 1.0.7)

divide = Slider(10, range=5..20)
flap_angle = Slider(90, range=0..180)

vec = VectorXYZ(XComponent=Slider(0, range=0..1), YComponent=Slider(0, range=0..1), ZComponent=Slider(0.25, range=0..1))  # -> unitize(Vector), Length
box = Box({Plane=Plane(origin=(-8.514936895, -1.179354141, 0), x=(1, 0, 0), y=(0, -1, 0)), X=Domain(0, 5.330680715), Y=Domain(0, 3.679584919), Z=Domain(-3.972165592, 0)})  # disabled
c_script = CSharpScript(x=box, y=Slider(48.018, range=0..90), z=vec.Vector)  # -> out, A; inputs x: Box, y: Double, z: Vector3d
# ---------- c_script: C# ----------
double a = y * Math.PI /180.0;
Point3d c = new Point3d(0,0,0);
Transform R = Transform.Rotation(a, z, c);
Box X = x; X.Transform(R);
A = X;
# ---------- end c_script ----------
box_2 = Box(c_script.A)  # disabled

rectangle = Rectangle(Plane=PlaneXY(0, 0, 0), XSize=Slider(17.881, range=10..20), YSize=Slider(10.301, range=10..20), Radius=0)  # -> Rectangle, Length
cp = ControlPoints(Curve=rectangle.Rectangle)  # -> Points, Weights, Knots
Y = Slider(0, range=-20..20)
Z = Slider(0, range=-20..20)
X = Slider(-20, range=-20..20)
c_script_2 = CSharpScript(Points=cp.Points, N=divide)  # -> out, CurvePoint, Bezier_2d, Bezier_3d; inputs Points: list of Point3d, N: Int32
# ---------- c_script_2: C# ----------
    List<Point3d> CP = new List<Point3d>();
    List<Point3d> BP_2d = new List<Point3d>();
    List<Point3d> BP_3d = new List<Point3d>();
    List<double> _Phi = new List<double>();

    Point3d p0 = Points[0],  p3 = Points[1];
    double y = Points[3].Y / 2;

    Point3d p1 = p3 / 4.0 + 3.0 / 4.0 * p0; p1.Y += y;
    Point3d p2 = p0 / 4.0 + 3.0 / 4.0 * p3; p2.Y += y;
    CP.Add(p0); CP.Add(p1); CP.Add(p2); CP.Add(p3);

    for(int n = 0; n < N; n++){
      double t = 1 - (double) n / (double) (N - 1);
      Point3d p = new Point3d(0, 0, 0);
      for(int i = 0; i < 4; i++)p += cmb(3, i) * Math.Pow(1.0 - t, 3 - i) * Math.Pow(t, i) * CP[i];
      BP_2d.Add(p);
      BP_3d.Add(new Point3d(p.X, p.Y, p.Z));
    }

    double phi = Math.PI/2 - Math.PI/10;
    Vector3d AxisY = new Vector3d(0, 1, 0);
    for(int i = 1; i < N - 1; i++){
      Vector3d v = BP_3d[i] - BP_3d[0];v.Rotate(phi, AxisY);
      BP_3d[i] = BP_3d[0] + v;
    }
    
    phi = Math.PI/10;
    for(int n = 1; n < N-1; n++){
      //if(n > N / 2)phi =2*Math.PI - Math.Abs(phi);
      for(int i = n + 1; i < N - 1; i++){
        Vector3d v = BP_3d[i] - BP_3d[n];v.Rotate(-phi, AxisY);
        BP_3d[i] = BP_3d[n] + v;
      }
    }

    CurvePoint = BP_2d.Count;
    Bezier_2d = BP_2d;
    Bezier_3d = BP_3d;
# ---------- c_script_2: C# additional code ----------
  double fact(int n){
    if(n <= 1)return 1;
    return n * fact(n - 1);
  }
  double cmb(int n, int k){
    return fact(n) / fact(k);
  }

  /// <summary>
  /// This method will be called once every solution, before any calls to RunScript.
  /// </summary>
  public override void BeforeRunScript()
  { }
  /// <summary>
  /// This method will be called once every solution, after any calls to RunScript.
  /// </summary>
  public override void AfterRunScript()
  { }
# ---------- end c_script_2 ----------
vec_2 = VectorXYZ(XComponent=X, YComponent=Y, ZComponent=Z)  # -> Vector, Length
pt = Point(c_script_2.Bezier_2d)
pt_2 = Point(c_script_2.Bezier_3d)
panel = Panel(c_script_2.out)
move = Move(Geometry=[pt_2, cp.Points], Motion=vec_2.Vector)  # -> Geometry, Transform
